# Grasshopper definition MULTITASKING END EFFECTOR - IAAC (Arpan Mathe, Charng Shin Schen).gh (Grasshopper 1.0.7)
# plug-ins: Robots

number_slider = Slider(50, range=0..1000)  # disabled
Y = UnitY(Factor=number_slider)  # disabled

R = Point(Point(-105.005394, 49.99462891, 164.1999969))  # disabled
M = Point(Point(-105.005394, -0.00537181925, 164.1999969))  # disabled
L = Point(Point(-105.005394, -50.00537254, 164.1999969))  # disabled
panel = Panel(M)  # disabled
panel_2 = Panel(R)  # disabled
panel_3 = Panel(L)  # disabled
pdecon = Deconstruct(Point=M)  # -> XComponent, YComponent, ZComponent; disabled
pt = ConstructPoint(XCoordinate=pdecon.XComponent, YCoordinate=pdecon.YComponent, ZCoordinate=pdecon.ZComponent)  # disabled
move = Move(Geometry=pt, Motion=Y)  # -> Geometry, Transform; disabled
xy = XYPlane(Origin=move.Geometry)  # disabled
pflip = FlipPlane(Plane=xy, ReverseX=False, ReverseY=False, SwapAxes=True)  # disabled
number_slider_2 = Slider(210, range=0..360)  # disabled
name_of_your_tool = Panel("vacuum")  # disabled
prot = RotatePlane(Plane=pflip, Angle=degrees(number_slider_2))  # disabled
vacuum = Mesh(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)  # disabled
tool = CreateTool(Name=name_of_your_tool, TCP=prot, Weight=0, Mesh=vacuum)  # -> Tool, TCP; disabled

# ---- group: Robot Table display
# Group 2: Multitask Effector
number_slider_3 = Slider(0.89, range=0..1)
abb_table_iaac = Geometry([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, Point(0, 0, 0)])
material = CreateMaterial(
    Diffuse=ColourSwatch(SwatchColor=RGB(222, 222, 222)),
    Specular=RGB(255, 255, 255),
    Emission=RGB(0, 0, 0),
    Transparency=number_slider_3,
    Shine=0)
preview = CustomPreview(Geometry=abb_table_iaac, Shader=material)

# ----
brep = Brep(<brep referenced from the Rhino model>)

# ---- group: 01_Tool_Spray Extruder
pt_2 = Point(<point referenced from the Rhino model>)
pdecon_2 = Deconstruct(Point=pt_2)  # -> XComponent, YComponent, ZComponent
pt_3 = ConstructPoint(XCoordinate=pdecon_2.XComponent, YCoordinate=pdecon_2.YComponent, ZCoordinate=pdecon_2.ZComponent)
yz = YZPlane(Origin=Point(0, 0, 0))
pl = PlaneNormal(Origin=pt_3, ZAxis=yz)
rot3d = Rotate3D(Geometry=pl, Angle=degrees(Slider(0, range=0..360)), Center=pt_3, Axis=pl)  # -> Geometry, Transform
pflip_2 = FlipPlane(Plane=rot3d.Geometry, ReverseX=False, ReverseY=False, SwapAxes=True)
name_of_your_tool_2 = Panel("Spraying")
mesh = Mesh(brep)
tool_2 = CreateTool(Name=name_of_your_tool_2, TCP=pflip_2, Weight=0, Mesh=mesh)  # -> Tool, TCP

# ---- group: Robot settings
list = ValueList({"AA-KR60", "AA-KR30", "AA-KR60_KR30", "AARCH IRB120", "AARCH IRB6620", "Bartlett-IRB120", "Bartlett-IRB1600", "Bartlett-KR6", "Bartlett-KR60", "Bartlett-UR10", "Bigli-KR20", "ETH-Gantry", "Grymsdyke-IRB120", "Grymsdyke-KR210", "iaac-KR150-2_110", "iaac-IRB140", "iaac-IRB120", "EXArchitects-IRB6700", "KULeuven-IRB120", "KULeuven-UR5", "KULeuven-UR10", "IRB4600-205", "UEL IRB6620", "uem-IRB120", "uem-IRB1600", "uem-IRB2600", "uem-IRB1600_IRB2600", "UniMelb-IRB120", "UniMelb-IRB1200"}, selected="iaac-IRB140")
xy_2 = XYPlane(Origin=Point(0, 0, 0))
speed_fast = Panel("150")
zone = Panel("10")
load_robot = LoadRobotSystem(Name=list, Base=xy_2)

# ----
speed_slow = Panel("30")
crv = Curve([<curve referenced from the Rhino model> x8])
crv_2 = Curve([<curve referenced from the Rhino model> x17])
item = ListItem(List=crv, Index=0, Wrap=True)  # -> Item, Item1, Item2, Item3, Item4, Item5, Item6, Item7
curvepoint = PointOnCurve(crv_2, parameter=0.5)
crv_3 = Curve(item.Item2)
crv_4 = Curve(item.Item)
crv_5 = Curve(item.Item1)
crv_6 = Curve(item.Item3)
crv_7 = Curve(item.Item4)
crv_8 = Curve(item.Item5)
crv_9 = Curve(item.Item6)
crv_10 = Curve(item.Item7)
points = PointList(Points=curvepoint)
Z = UnitZ(Factor=Slider(100, range=0..100))

divlength = DivideLength(Curve=flatten(crv_4), Length="1")  # -> Points, Tangents, Parameters
vdis = VectorDisplay(Anchor=divlength.Points)
xy_3 = XYPlane(Origin=Point(0, 0, 0))
pl_2 = PlaneNormal(Origin=flatten(divlength.Points), ZAxis=xy_3)
rot3d_2 = Rotate3D(Geometry=pl_2, Angle=degrees(Slider(0, range=0..360)), Center=flatten(divlength.Points), Axis=pl_2)  # -> Geometry, Transform
item_2 = ListItem(List=rot3d_2.Geometry, Index=0, Wrap=True)
item_3 = ListItem(List=rot3d_2.Geometry, Index=-1, Wrap=True)
move_2 = Move(Geometry=item_2, Motion=Z)  # -> Geometry, Transform
move_3 = Move(Geometry=item_3, Motion=Z)  # -> Geometry, Transform
xy_4 = XYPlane(Origin=move_2.Geometry)
xy_5 = XYPlane(Origin=move_3.Geometry)
deplane = DeconstructPlane(Plane=xy_4)  # -> Origin, XAxis, YAxis, ZAxis
deplane_2 = DeconstructPlane(Plane=xy_5)  # -> Origin, XAxis, YAxis, ZAxis
rot3d_3 = Rotate3D(Geometry=xy_4, Angle=degrees(Slider(0, range=0..1000)), Center=xy_4, Axis=deplane.YAxis)  # -> Geometry, Transform
rot3d_4 = Rotate3D(Geometry=xy_5, Angle=degrees(Slider(0, range=0..1000)), Center=xy_5, Axis=deplane_2.YAxis)  # -> Geometry, Transform
list_2 = ValueList({"Joint", "Linear"}, selected="Linear")
list_3 = ValueList({"Joint", "Linear"}, selected="Linear")
list_4 = ValueList({"Joint", "Linear"}, selected="Linear")

divlength_2 = DivideLength(Curve=flatten(crv_5), Length="1")  # -> Points, Tangents, Parameters
vdis_2 = VectorDisplay(Anchor=divlength_2.Points)
xy_6 = XYPlane(Origin=Point(0, 0, 0))
pl_3 = PlaneNormal(Origin=flatten(divlength_2.Points), ZAxis=xy_6)
rot3d_5 = Rotate3D(Geometry=pl_3, Angle=degrees(Slider(0, range=0..360)), Center=flatten(divlength_2.Points), Axis=pl_3)  # -> Geometry, Transform
item_4 = ListItem(List=rot3d_5.Geometry, Index=0, Wrap=True)
item_5 = ListItem(List=rot3d_5.Geometry, Index=-1, Wrap=True)
move_4 = Move(Geometry=item_4, Motion=Z)  # -> Geometry, Transform
move_5 = Move(Geometry=item_5, Motion=Z)  # -> Geometry, Transform
xy_7 = XYPlane(Origin=move_4.Geometry)
xy_8 = XYPlane(Origin=move_5.Geometry)
deplane_3 = DeconstructPlane(Plane=xy_7)  # -> Origin, XAxis, YAxis, ZAxis
deplane_4 = DeconstructPlane(Plane=xy_8)  # -> Origin, XAxis, YAxis, ZAxis
rot3d_6 = Rotate3D(Geometry=xy_7, Angle=degrees(Slider(0, range=0..1000)), Center=xy_7, Axis=deplane_3.YAxis)  # -> Geometry, Transform
rot3d_7 = Rotate3D(Geometry=xy_8, Angle=degrees(Slider(0, range=0..1000)), Center=xy_8, Axis=deplane_4.YAxis)  # -> Geometry, Transform
list_5 = ValueList({"Joint", "Linear"}, selected="Linear")
list_6 = ValueList({"Joint", "Linear"}, selected="Linear")
list_7 = ValueList({"Joint", "Linear"}, selected="Linear")

divlength_3 = DivideLength(Curve=flatten(crv_3), Length="1")  # -> Points, Tangents, Parameters
vdis_3 = VectorDisplay(Anchor=divlength_3.Points)
xy_9 = XYPlane(Origin=Point(0, 0, 0))
pl_4 = PlaneNormal(Origin=flatten(divlength_3.Points), ZAxis=xy_9)
rot3d_8 = Rotate3D(Geometry=pl_4, Angle=degrees(Slider(0, range=0..360)), Center=flatten(divlength_3.Points), Axis=pl_4)  # -> Geometry, Transform
item_6 = ListItem(List=rot3d_8.Geometry, Index=0, Wrap=True)
item_7 = ListItem(List=rot3d_8.Geometry, Index=-1, Wrap=True)
move_6 = Move(Geometry=item_6, Motion=Z)  # -> Geometry, Transform
move_7 = Move(Geometry=item_7, Motion=Z)  # -> Geometry, Transform
xy_10 = XYPlane(Origin=move_6.Geometry)
xy_11 = XYPlane(Origin=move_7.Geometry)
deplane_5 = DeconstructPlane(Plane=xy_10)  # -> Origin, XAxis, YAxis, ZAxis
deplane_6 = DeconstructPlane(Plane=xy_11)  # -> Origin, XAxis, YAxis, ZAxis
rot3d_9 = Rotate3D(Geometry=xy_10, Angle=degrees(Slider(0, range=0..1000)), Center=xy_10, Axis=deplane_5.YAxis)  # -> Geometry, Transform
rot3d_10 = Rotate3D(Geometry=xy_11, Angle=degrees(Slider(0, range=0..1000)), Center=xy_11, Axis=deplane_6.YAxis)  # -> Geometry, Transform
list_8 = ValueList({"Joint", "Linear"}, selected="Linear")
list_9 = ValueList({"Joint", "Linear"}, selected="Linear")
list_10 = ValueList({"Joint", "Linear"}, selected="Linear")

divlength_4 = DivideLength(Curve=flatten(crv_6), Length="1")  # -> Points, Tangents, Parameters
vdis_4 = VectorDisplay(Anchor=divlength_4.Points)
xy_12 = XYPlane(Origin=Point(0, 0, 0))
pl_5 = PlaneNormal(Origin=flatten(divlength_4.Points), ZAxis=xy_12)
rot3d_11 = Rotate3D(Geometry=pl_5, Angle=degrees(Slider(0, range=0..360)), Center=flatten(divlength_4.Points), Axis=pl_5)  # -> Geometry, Transform
item_8 = ListItem(List=rot3d_11.Geometry, Index=0, Wrap=True)
item_9 = ListItem(List=rot3d_11.Geometry, Index=-1, Wrap=True)
move_8 = Move(Geometry=item_8, Motion=Z)  # -> Geometry, Transform
move_9 = Move(Geometry=item_9, Motion=Z)  # -> Geometry, Transform
xy_13 = XYPlane(Origin=move_8.Geometry)
xy_14 = XYPlane(Origin=move_9.Geometry)
deplane_7 = DeconstructPlane(Plane=xy_13)  # -> Origin, XAxis, YAxis, ZAxis
deplane_8 = DeconstructPlane(Plane=xy_14)  # -> Origin, XAxis, YAxis, ZAxis
rot3d_12 = Rotate3D(Geometry=xy_13, Angle=degrees(Slider(0, range=0..1000)), Center=xy_13, Axis=deplane_7.YAxis)  # -> Geometry, Transform
rot3d_13 = Rotate3D(Geometry=xy_14, Angle=degrees(Slider(0, range=0..1000)), Center=xy_14, Axis=deplane_8.YAxis)  # -> Geometry, Transform
list_11 = ValueList({"Joint", "Linear"}, selected="Linear")
list_12 = ValueList({"Joint", "Linear"}, selected="Linear")
list_13 = ValueList({"Joint", "Linear"}, selected="Linear")

divlength_5 = DivideLength(Curve=flatten(crv_2), Length="10")  # -> Points, Tangents, Parameters

divlength_6 = DivideLength(Curve=flatten(crv_7), Length="1")  # -> Points, Tangents, Parameters
vdis_5 = VectorDisplay(Anchor=divlength_6.Points)
xy_15 = XYPlane(Origin=Point(0, 0, 0))
pl_6 = PlaneNormal(Origin=flatten(divlength_6.Points), ZAxis=xy_15)
rot3d_14 = Rotate3D(Geometry=pl_6, Angle=degrees(Slider(0, range=0..360)), Center=flatten(divlength_6.Points), Axis=pl_6)  # -> Geometry, Transform
item_10 = ListItem(List=rot3d_14.Geometry, Index=0, Wrap=True)
item_11 = ListItem(List=rot3d_14.Geometry, Index=-1, Wrap=True)
move_10 = Move(Geometry=item_10, Motion=Z)  # -> Geometry, Transform
move_11 = Move(Geometry=item_11, Motion=Z)  # -> Geometry, Transform
xy_16 = XYPlane(Origin=move_10.Geometry)
xy_17 = XYPlane(Origin=move_11.Geometry)
deplane_9 = DeconstructPlane(Plane=xy_16)  # -> Origin, XAxis, YAxis, ZAxis
deplane_10 = DeconstructPlane(Plane=xy_17)  # -> Origin, XAxis, YAxis, ZAxis
rot3d_15 = Rotate3D(Geometry=xy_16, Angle=degrees(Slider(0, range=0..1000)), Center=xy_16, Axis=deplane_9.YAxis)  # -> Geometry, Transform
rot3d_16 = Rotate3D(Geometry=xy_17, Angle=degrees(Slider(0, range=0..1000)), Center=xy_17, Axis=deplane_10.YAxis)  # -> Geometry, Transform
list_14 = ValueList({"Joint", "Linear"}, selected="Linear")
list_15 = ValueList({"Joint", "Linear"}, selected="Linear")
list_16 = ValueList({"Joint", "Linear"}, selected="Linear")

divlength_7 = DivideLength(Curve=flatten(crv_8), Length="1")  # -> Points, Tangents, Parameters
vdis_6 = VectorDisplay(Anchor=divlength_7.Points)
xy_18 = XYPlane(Origin=Point(0, 0, 0))
pl_7 = PlaneNormal(Origin=flatten(divlength_7.Points), ZAxis=xy_18)
rot3d_17 = Rotate3D(Geometry=pl_7, Angle=degrees(Slider(0, range=0..360)), Center=flatten(divlength_7.Points), Axis=pl_7)  # -> Geometry, Transform
item_12 = ListItem(List=rot3d_17.Geometry, Index=0, Wrap=True)
item_13 = ListItem(List=rot3d_17.Geometry, Index=-1, Wrap=True)
move_12 = Move(Geometry=item_12, Motion=Z)  # -> Geometry, Transform
move_13 = Move(Geometry=item_13, Motion=Z)  # -> Geometry, Transform
xy_19 = XYPlane(Origin=move_12.Geometry)
xy_20 = XYPlane(Origin=move_13.Geometry)
deplane_11 = DeconstructPlane(Plane=xy_19)  # -> Origin, XAxis, YAxis, ZAxis
deplane_12 = DeconstructPlane(Plane=xy_20)  # -> Origin, XAxis, YAxis, ZAxis
rot3d_18 = Rotate3D(Geometry=xy_19, Angle=degrees(Slider(0, range=0..1000)), Center=xy_19, Axis=deplane_11.YAxis)  # -> Geometry, Transform
rot3d_19 = Rotate3D(Geometry=xy_20, Angle=degrees(Slider(0, range=0..1000)), Center=xy_20, Axis=deplane_12.YAxis)  # -> Geometry, Transform
list_17 = ValueList({"Joint", "Linear"}, selected="Linear")
list_18 = ValueList({"Joint", "Linear"}, selected="Linear")
list_19 = ValueList({"Joint", "Linear"}, selected="Linear")

vdis_7 = VectorDisplay(Anchor=divlength_5.Points)

divlength_8 = DivideLength(Curve=flatten(crv_9), Length="1")  # -> Points, Tangents, Parameters
vdis_8 = VectorDisplay(Anchor=divlength_8.Points)
xy_21 = XYPlane(Origin=Point(0, 0, 0))
pl_8 = PlaneNormal(Origin=flatten(divlength_8.Points), ZAxis=xy_21)
rot3d_20 = Rotate3D(Geometry=pl_8, Angle=degrees(Slider(0, range=0..360)), Center=flatten(divlength_8.Points), Axis=pl_8)  # -> Geometry, Transform
item_14 = ListItem(List=rot3d_20.Geometry, Index=0, Wrap=True)
item_15 = ListItem(List=rot3d_20.Geometry, Index=-1, Wrap=True)
move_14 = Move(Geometry=item_14, Motion=Z)  # -> Geometry, Transform
move_15 = Move(Geometry=item_15, Motion=Z)  # -> Geometry, Transform
xy_22 = XYPlane(Origin=move_14.Geometry)
xy_23 = XYPlane(Origin=move_15.Geometry)
deplane_13 = DeconstructPlane(Plane=xy_22)  # -> Origin, XAxis, YAxis, ZAxis
deplane_14 = DeconstructPlane(Plane=xy_23)  # -> Origin, XAxis, YAxis, ZAxis
rot3d_21 = Rotate3D(Geometry=xy_22, Angle=degrees(Slider(0, range=0..1000)), Center=xy_22, Axis=deplane_13.YAxis)  # -> Geometry, Transform
rot3d_22 = Rotate3D(Geometry=xy_23, Angle=degrees(Slider(0, range=0..1000)), Center=xy_23, Axis=deplane_14.YAxis)  # -> Geometry, Transform
list_20 = ValueList({"Joint", "Linear"}, selected="Linear")
list_21 = ValueList({"Joint", "Linear"}, selected="Linear")
list_22 = ValueList({"Joint", "Linear"}, selected="Linear")

divlength_9 = DivideLength(Curve=flatten(crv_10), Length="1")  # -> Points, Tangents, Parameters
vdis_9 = VectorDisplay(Anchor=divlength_9.Points)
xy_24 = XYPlane(Origin=Point(0, 0, 0))
pl_9 = PlaneNormal(Origin=flatten(divlength_9.Points), ZAxis=xy_24)
rot3d_23 = Rotate3D(Geometry=pl_9, Angle=degrees(Slider(0, range=0..360)), Center=flatten(divlength_9.Points), Axis=pl_9)  # -> Geometry, Transform
item_16 = ListItem(List=rot3d_23.Geometry, Index=0, Wrap=True)
item_17 = ListItem(List=rot3d_23.Geometry, Index=-1, Wrap=True)
move_16 = Move(Geometry=item_16, Motion=Z)  # -> Geometry, Transform
move_17 = Move(Geometry=item_17, Motion=Z)  # -> Geometry, Transform
xy_25 = XYPlane(Origin=move_16.Geometry)
xy_26 = XYPlane(Origin=move_17.Geometry)
deplane_15 = DeconstructPlane(Plane=xy_25)  # -> Origin, XAxis, YAxis, ZAxis
deplane_16 = DeconstructPlane(Plane=xy_26)  # -> Origin, XAxis, YAxis, ZAxis
rot3d_24 = Rotate3D(Geometry=xy_25, Angle=degrees(Slider(0, range=0..1000)), Center=xy_25, Axis=deplane_15.YAxis)  # -> Geometry, Transform
rot3d_25 = Rotate3D(Geometry=xy_26, Angle=degrees(Slider(0, range=0..1000)), Center=xy_26, Axis=deplane_16.YAxis)  # -> Geometry, Transform
list_23 = ValueList({"Joint", "Linear"}, selected="Linear")
list_24 = ValueList({"Joint", "Linear"}, selected="Linear")
list_25 = ValueList({"Joint", "Linear"}, selected="Linear")

xy_27 = XYPlane(Origin=Point(0, 0, 0))
pl_10 = PlaneNormal(Origin=flatten(divlength_5.Points), ZAxis=xy_27)
pt_4 = Point(<point referenced from the Rhino model>)
xy_28 = XYPlane(Origin=pt_4)
deplane_17 = DeconstructPlane(Plane=xy_28)  # -> Origin, XAxis, YAxis, ZAxis
rot3d_26 = Rotate3D(Geometry=xy_28, Angle=degrees(Slider(0, range=0..1000)), Center=xy_28, Axis=deplane_17.YAxis)  # -> Geometry, Transform
rot3d_27 = Rotate3D(Geometry=pl_10, Angle=degrees(Slider(0, range=0..360)), Center=flatten(divlength_5.Points), Axis=pl_10)  # -> Geometry, Transform
item_18 = ListItem(List=rot3d_27.Geometry, Index=0, Wrap=True)
item_19 = ListItem(List=rot3d_27.Geometry, Index=-1, Wrap=True)
move_18 = Move(Geometry=item_18, Motion=Z)  # -> Geometry, Transform
move_19 = Move(Geometry=item_19, Motion=Z)  # -> Geometry, Transform
xy_29 = XYPlane(Origin=move_18.Geometry)
xy_30 = XYPlane(Origin=move_19.Geometry)
deplane_18 = DeconstructPlane(Plane=xy_29)  # -> Origin, XAxis, YAxis, ZAxis
deplane_19 = DeconstructPlane(Plane=xy_30)  # -> Origin, XAxis, YAxis, ZAxis
rot3d_28 = Rotate3D(Geometry=xy_29, Angle=degrees(Slider(0, range=0..1000)), Center=xy_29, Axis=deplane_18.YAxis)  # -> Geometry, Transform
rot3d_29 = Rotate3D(Geometry=xy_30, Angle=degrees(Slider(0, range=0..1000)), Center=xy_30, Axis=deplane_19.YAxis)  # -> Geometry, Transform

# ---- group: 01 Homing
panel_4 = Panel("""0
0
0
0
0
0""")
degtorad = DegreesToRadians(Degrees=panel_4, RobotSystem=load_robot, MechanicalGroup=0)
target = CreateTarget(Joints=degtorad, Tool=tool_2.Tool, Speed=speed_fast, Zone=zone, IsCartesian=False)

# ----
setdo = SetDO(DO="2", Value=Toggle(False))

setdo_2 = SetDO(DO="2", Value=Toggle(True))

setdo_3 = SetDO(DO="2", Value=Toggle(False))

setdo_4 = SetDO(DO="2", Value=Toggle(False))

setdo_5 = SetDO(DO="2", Value=Toggle(True))

setdo_6 = SetDO(DO="2", Value=Toggle(False))

setdo_7 = SetDO(DO="2", Value=Toggle(False))

setdo_8 = SetDO(DO="2", Value=Toggle(True))

setdo_9 = SetDO(DO="2", Value=Toggle(False))

setdo_10 = SetDO(DO="2", Value=Toggle(False))

setdo_11 = SetDO(DO="2", Value=Toggle(True))

setdo_12 = SetDO(DO="2", Value=Toggle(False))
groupcmd = GroupCommand(Commands=setdo_12)

setdo_13 = SetDO(DO="2", Value=Toggle(False))

setdo_14 = SetDO(DO="2", Value=Toggle(True))

setdo_15 = SetDO(DO="2", Value=Toggle(False))

setdo_16 = SetDO(DO="2", Value=Toggle(False))

setdo_17 = SetDO(DO="2", Value=Toggle(True))

setdo_18 = SetDO(DO="1", Value=Toggle(False))

setdo_19 = SetDO(DO="1", Value=Toggle(True))

setdo_20 = SetDO(DO="1", Value=Toggle(False))

setdo_21 = SetDO(DO="2", Value=Toggle(False))

setdo_22 = SetDO(DO="2", Value=Toggle(False))

setdo_23 = SetDO(DO="2", Value=Toggle(True))

setdo_24 = SetDO(DO="2", Value=Toggle(False))

setdo_25 = SetDO(DO="2", Value=Toggle(False))

setdo_26 = SetDO(DO="2", Value=Toggle(True))

setdo_27 = SetDO(DO="2", Value=Toggle(False))

list_26 = ValueList({"Joint", "Linear"}, selected="Joint")
list_27 = ValueList({"Joint", "Linear"}, selected="Linear")
list_28 = ValueList({"Joint", "Linear"}, selected="Linear")
list_29 = ValueList({"Joint", "Linear"}, selected="Linear")

# ---- group: Intermediate Position
target_2 = CreateTarget(Plane=rot3d_26.Geometry, Motion=list_26, Tool=tool_2.Tool, Speed=speed_fast, Zone=zone, IsCartesian=True)

# ---- group: Approach Position
target_3 = CreateTarget(
    Plane=rot3d_28.Geometry,
    Motion=list_27,
    Tool=tool_2.Tool,
    Speed=speed_fast,
    Zone=zone,
    Command=setdo_18,
    IsCartesian=True)

# ---- group: Extrustion Toolpath
target_4 = CreateTarget(
    Plane=rot3d_27.Geometry,
    Motion=list_28,
    Tool=tool_2.Tool,
    Speed=speed_fast,
    Zone=zone,
    Command=setdo_19,
    IsCartesian=True)

# ---- group: Departure Position
target_5 = CreateTarget(
    Plane=rot3d_29.Geometry,
    Motion=list_29,
    Tool=tool_2.Tool,
    Speed=speed_fast,
    Zone=zone,
    Command=setdo_20,
    IsCartesian=True)

# ----
octal_to_binary = Panel("""0 = 0,0,0
1 = 0,0,1 (100 pwm)
2 = 0,1,0 (150 pwm)
3 = 0,1,1 (180 pwm)
4 = 1,0,0 (200 pwm)""")

# ---- group: 01_Tool_CNC Milling
pt_5 = Point(<point referenced from the Rhino model>)
pdecon_3 = Deconstruct(Point=pt_5)  # -> XComponent, YComponent, ZComponent
pt_6 = ConstructPoint(XCoordinate=pdecon_3.XComponent, YCoordinate=pdecon_3.YComponent, ZCoordinate=pdecon_3.ZComponent)
yz_2 = YZPlane(Origin=Point(0, 0, 0))
pl_11 = PlaneNormal(Origin=pt_6, ZAxis=yz_2)
rot3d_30 = Rotate3D(Geometry=pl_11, Angle=degrees(Slider(90, range=0..360)), Center=pt_6, Axis=pl_11)  # -> Geometry, Transform
name_of_your_tool_3 = Panel("Milling")
mesh_2 = Mesh(brep)

# ----
deplane_20 = DeconstructPlane(Plane=pl_11)  # -> Origin, XAxis, YAxis, ZAxis
rot3d_31 = Rotate3D(Geometry=rot3d_30.Geometry, Angle=degrees(Slider(0, range=0..360)), Center=pl_11, Axis=deplane_20.ZAxis)  # -> Geometry, Transform

# ---- group: 01_Tool_CNC Milling (continued)
tool_3 = CreateTool(Name=name_of_your_tool_3, TCP=rot3d_31.Geometry, Weight=0, Mesh=mesh_2)  # -> Tool, TCP

# ---- group: Approach Position
target_6 = CreateTarget(Plane=rot3d_3.Geometry, Motion=list_2, Tool=tool_3.Tool, Speed=speed_fast, Zone=zone, Command=setdo, IsCartesian=True)

# ---- group: CNC Toolpath
target_7 = CreateTarget(Plane=rot3d_2.Geometry, Motion=list_3, Tool=tool_3.Tool, Speed=speed_fast, Zone=zone, Command=setdo_2, IsCartesian=True)

# ---- group: Departure Position
target_8 = CreateTarget(Plane=rot3d_4.Geometry, Motion=list_4, Tool=tool_3.Tool, Speed=speed_fast, Zone=zone, Command=setdo_3, IsCartesian=True)

# ---- group: Approach Position
target_9 = CreateTarget(Plane=rot3d_6.Geometry, Motion=list_5, Tool=tool_3.Tool, Speed=speed_fast, Zone=zone, Command=setdo_4, IsCartesian=True)

# ---- group: CNC Toolpath
target_10 = CreateTarget(Plane=rot3d_5.Geometry, Motion=list_6, Tool=tool_3.Tool, Speed=speed_fast, Zone=zone, Command=setdo_5, IsCartesian=True)

# ---- group: Departure Position
target_11 = CreateTarget(Plane=rot3d_7.Geometry, Motion=list_7, Tool=tool_3.Tool, Speed=speed_fast, Zone=zone, Command=setdo_6, IsCartesian=True)

# ---- group: Approach Position
target_12 = CreateTarget(Plane=rot3d_9.Geometry, Motion=list_8, Tool=tool_3.Tool, Speed=speed_fast, Zone=zone, Command=setdo_7, IsCartesian=True)

# ---- group: CNC Toolpath
target_13 = CreateTarget(Plane=rot3d_8.Geometry, Motion=list_9, Tool=tool_3.Tool, Speed=speed_fast, Zone=zone, Command=setdo_8, IsCartesian=True)

# ---- group: Departure Position
target_14 = CreateTarget(
    Plane=rot3d_10.Geometry,
    Motion=list_10,
    Tool=tool_3.Tool,
    Speed=speed_fast,
    Zone=zone,
    Command=setdo_9,
    IsCartesian=True)

# ---- group: Approach Position
target_15 = CreateTarget(
    Plane=rot3d_12.Geometry,
    Motion=list_11,
    Tool=tool_3.Tool,
    Speed=speed_fast,
    Zone=zone,
    Command=setdo_10,
    IsCartesian=True)

# ---- group: CNC Toolpath
target_16 = CreateTarget(
    Plane=rot3d_11.Geometry,
    Motion=list_12,
    Tool=tool_3.Tool,
    Speed=speed_fast,
    Zone=zone,
    Command=setdo_11,
    IsCartesian=True)

# ---- group: Departure Position
target_17 = CreateTarget(
    Plane=rot3d_13.Geometry,
    Motion=list_13,
    Tool=tool_3.Tool,
    Speed=speed_fast,
    Zone=zone,
    Command=groupcmd,
    IsCartesian=True)

# ---- group: Approach Position
target_18 = CreateTarget(
    Plane=rot3d_15.Geometry,
    Motion=list_14,
    Tool=tool_3.Tool,
    Speed=speed_fast,
    Zone=zone,
    Command=setdo_13,
    IsCartesian=True)

# ---- group: CNC Toolpath
target_19 = CreateTarget(
    Plane=rot3d_14.Geometry,
    Motion=list_15,
    Tool=tool_3.Tool,
    Speed=speed_fast,
    Zone=zone,
    Command=setdo_14,
    IsCartesian=True)

# ---- group: Departure Position
target_20 = CreateTarget(
    Plane=rot3d_16.Geometry,
    Motion=list_16,
    Tool=tool_3.Tool,
    Speed=speed_fast,
    Zone=zone,
    Command=setdo_15,
    IsCartesian=True)

# ---- group: Approach Position
target_21 = CreateTarget(
    Plane=rot3d_18.Geometry,
    Motion=list_17,
    Tool=tool_3.Tool,
    Speed=speed_fast,
    Zone=zone,
    Command=setdo_16,
    IsCartesian=True)

# ---- group: CNC Toolpath
target_22 = CreateTarget(
    Plane=rot3d_17.Geometry,
    Motion=list_18,
    Tool=tool_3.Tool,
    Speed=speed_fast,
    Zone=zone,
    Command=setdo_17,
    IsCartesian=True)

# ---- group: Departure Position
target_23 = CreateTarget(
    Plane=rot3d_19.Geometry,
    Motion=list_19,
    Tool=tool_3.Tool,
    Speed=speed_fast,
    Zone=zone,
    Command=setdo_21,
    IsCartesian=True)

# ---- group: Approach Position
target_24 = CreateTarget(
    Plane=rot3d_21.Geometry,
    Motion=list_20,
    Tool=tool_3.Tool,
    Speed=speed_fast,
    Zone=zone,
    Command=setdo_22,
    IsCartesian=True)

# ---- group: CNC Toolpath
target_25 = CreateTarget(
    Plane=rot3d_20.Geometry,
    Motion=list_21,
    Tool=tool_3.Tool,
    Speed=speed_fast,
    Zone=zone,
    Command=setdo_23,
    IsCartesian=True)

# ---- group: Departure Position
target_26 = CreateTarget(
    Plane=rot3d_22.Geometry,
    Motion=list_22,
    Tool=tool_3.Tool,
    Speed=speed_fast,
    Zone=zone,
    Command=setdo_24,
    IsCartesian=True)

# ---- group: Approach Position
target_27 = CreateTarget(
    Plane=rot3d_24.Geometry,
    Motion=list_23,
    Tool=tool_3.Tool,
    Speed=speed_fast,
    Zone=zone,
    Command=setdo_25,
    IsCartesian=True)

# ---- group: CNC Toolpath
target_28 = CreateTarget(
    Plane=rot3d_23.Geometry,
    Motion=list_24,
    Tool=tool_3.Tool,
    Speed=speed_fast,
    Zone=zone,
    Command=setdo_26,
    IsCartesian=True)

# ---- group: Departure Position
target_29 = CreateTarget(
    Plane=rot3d_25.Geometry,
    Motion=list_25,
    Tool=tool_3.Tool,
    Speed=speed_fast,
    Zone=zone,
    Command=setdo_27,
    IsCartesian=True)

# ----
merge = Merge(Data1=target_27, Data2=target_28, Data3=target_29)
merge_2 = Merge(Data1=target_18, Data2=target_19, Data3=target_20)
merge_3 = Merge(Data1=target_21, Data2=target_22, Data3=target_23)
merge_4 = Merge(Data1=target_24, Data2=target_25, Data3=target_26)
merge_5 = Merge(Data1=target_15, Data2=target_16, Data3=target_17)
merge_6 = Merge(Data1=target_9, Data2=target_10, Data3=target_11)
merge_7 = Merge(Data1=target_12, Data2=target_13, Data3=target_14)
merge_8 = Merge(Data1=target_6, Data2=target_7, Data3=target_8)
merge_9 = Merge(Data1=merge_8, Data2=merge_6, Data3=merge_7, Data4=merge_5, Data5=merge_2, Data6=merge_3, Data7=merge_4, Data8=merge)
# Digital Output: Arduino_
# 
# 	Servo Pin=9;
# 	Motor Pin=3;
# ---
# 	Pin in arduino from optocouplet_
# 
# 	inpinservo = 5;
# 	inpinmotor1 = 6;
# 	inpinmotor2 = 7;
# 	inpinmotor3 = 8;
# ---
# 	Robot_
# 
# 	Servo=DO_1 (Grasshopper is 0)
# 	Motor=DO_2~4 (Grasshopper is 1~3)
merge_10 = Merge(Data1=target, Data2=target_2, Data3=target_3, Data4=target_4, Data5=target_5, Data6=merge_9, Data7=target)
program = CreateProgram(Name="Multitask", RobotSystem=load_robot, Targets1=flatten(merge_10), StepSize=1)  # -> Program, Code, Duration, Warnings, Errors
check_errors = Panel(program.Errors)
to_export_code_file_prg = Panel(program.Code)
sim = ProgramSimulation(Program=program.Program, Time=Slider(1, range=0..1), Normalized=True)  # -> SystemMeshes, JointRotations, Plane, Index, Time, Program, Errors
mesh_3 = Mesh(sim.SystemMeshes)
item_20 = ListItem(List=reverse(sim.Plane), Index=0, Wrap=True)
time_seconds = Panel(sim.Time)

# ---- group: Display simulation
trail = SimpleTrail(Program=sim.Program, Length=100000, MechanicalGroup=0)
preview_2 = CustomPreview(Geometry=trail, Shader=ColourSwatch(SwatchColor=RGB(51, 165, 255)))

# ---- group: to export file
txt = Text(flatten(program.Code))
file_name = Panel("test")
path = FilePath("E:\FINNNNNN")
python = GhPythonScript(program=txt, path=path, name=file_name, write=Button())  # -> out, a; inputs program: list
# ---------- python: Python ----------
import rhinoscriptsyntax as rs

if write:
    with open(path + name + '.prg', 'w') as file:
        for line in program:
            file.write(line)
            file.write('\n')
# ---------- end python ----------
